# Grasshopper definition BeadyRing_env.gh (Grasshopper 1.0.7)
# plug-ins: HoopSnake

number_slider = Slider(0, range=0..1)
number_slider_2 = Slider(0.5, range=0..1)  # disabled
cell_size = Slider(3, range=0..10)  # disabled
max_row_len = Slider(31, range=1..127)  # disabled
obs_size = Slider(9, range=1..15)  # disabled
number_slider_3 = Slider(0, range=0..1)  # disabled
python = GhPythonScript(carrier_color=number_slider_2, cell_size=cell_size, max_row_len=max_row_len, obs_size=obs_size)  # -> out, simplify(grid_world); inputs cell_size: Int32, max_row_len: Int32, obs_size: Int32; disabled
# ---------- python: Python ----------
from math import *
import scriptcontext as sc
import ghpythonlib.components as ghcomp
import ghpythonlib.treehelpers as th


pad = int(floor(_obs_size/2))
max_world_row_len = int(_max_row_len + 2*pad)

# grid world
xy_plane = ghcomp.XYPlane(ghcomp.ConstructPoint(0, 0, 0))
cell, _ = ghcomp.Rectangle(xy_plane, _cell_size, _cell_size, 0)

r_max = _cell_size*max_world_row_len
move_range = [i for i in range(0, r_max, _cell_size)]

y_vec = ghcomp.UnitY(move_range)
cell_col, _ = ghcomp.Move(cell, y_vec)

x_vec = ghcomp.UnitX(move_range)
grid_world = []
for c in cell_col:
    cell_row, _ = ghcomp.Move(c, x_vec)
    grid_world.append(cell_row)

grid_world = ghcomp.ReverseList(grid_world)
sc.sticky['grid_world'] = grid_world
grid_world_ = th.list_to_tree(grid_world, source=[0,0])

# innitial state
innit_state = [[255*_carrier_color for _ in range(int(max_world_row_len))] 
        for _ in range(int(max_world_row_len))]
sc.sticky['state'] = innit_state


R_space = [r for r in range(int(pad), int(_max_row_len + pad))]
C_space = [c for c in range(int(pad), int(_max_row_len + pad))]

RC_space = [[[r, c] for c in C_space] for r in R_space]
sc.sticky['RC_space'] = RC_space

R = int(floor(max_world_row_len/2))
C = int(floor(max_world_row_len/2))
x = R - pad
sc.sticky['x'] = x
y = C - pad
sc.sticky['y'] = y

def get_adjacent(x, y):
    adjacent = []
    if x < len(sc.sticky['RC_space']) - 1:
        adjacent.append([[x+1, y], sc.sticky['RC_space'][x+1][y]])
    if y > 0:
        adjacent.append([[x, y-1], sc.sticky['RC_space'][x][y-1]])
    if x > 0:
        adjacent.append([[x-1, y], sc.sticky['RC_space'][x-1][y]])
    if y < len(sc.sticky['RC_space'][sc.sticky['x']]) - 1:
        adjacent.append([[x, y+1], sc.sticky['RC_space'][x][y+1]])
    return adjacent

sc.sticky['adjacent_cells'] = get_adjacent(sc.sticky['x'], sc.sticky['y'])

sc.sticky['adj_cells'] = get_adjacent(sc.sticky['x'], sc.sticky['y'])
# ---------- end python ----------
srf = Surface(python.grid_world)  # disabled
swatch = ColourSwatch(SwatchColor=RGBA(0, 133, 105, 100))  # disabled
number_slider_4 = Slider(76, range=0..100)  # disabled
swatch_2 = ColourSwatch(SwatchColor=RGB(0, 0, 0))  # disabled
enable = GhPythonScript(iter=hs.IterationsCounter)  # -> enabled
# ---------- enable: Python ----------
import scriptcontext as sc

enabled = True
if sc.sticky["enabled"] is not None:
    enabled = sc.sticky["enabled"]
# ---------- end enable ----------
hs = HoopSnake(
    StartingData=number_slider,
    Data=number_slider,
    TerminationCondition=enable,
    Hoopsnake_Data_autoUpdate=False,
    Hoopsnake_Data_dataLimit=2147483647,
    Hoopsnake_Data_resetCounter=True,
    Hoopsnake_Data_updateView=True)  # -> Feedback, CumulativeFeedback, LoopsCounter, IterationsCounter
agent = GhPythonScript(iter=hs.IterationsCounter)  # -> action, reset
# ---------- agent: Python ----------
import socket
import struct
import pickle
import scriptcontext as sc


class Connection:
    def __init__(self, s):
        self._socket = s
        self._buffer = ""

    def receive_object(self):
        while len(self._buffer) < 4 or len(self._buffer) < struct.unpack("<L", self._buffer[:4])[0] + 4:
            new_bytes = self._socket.recv(16)
            if len(new_bytes) == 0:
                return None
            self._buffer += new_bytes
        length = struct.unpack("<L", self._buffer[:4])[0]
        header, body = self._buffer[:4], self._buffer[4:length + 4]
        obj = pickle.loads(body)
        self._buffer = self._buffer[length + 4:]
        return obj

    def send_object(self, d):
        body = pickle.dumps(d)
        header = struct.pack("<L", len(body))
        msg = header + body
        self._socket.send(msg)

# Connection
if iter == 0:
    addr = ("127.0.0.1", 50710)
    agent_socket = socket.socket(socket.AF_INET, socket.SOCK_STREAM)
    agent_socket.connect(addr)
    agent_conn = Connection(agent_socket)
    # Reset
    msg_in = agent_conn.receive_object()
    if msg_in == "reset":
        reset = True
        sc.sticky["enabled"] = True
    else:
        raise RuntimeError("First message must be 'reset'")
else:
    # Send message
    msg_out = {"observation": sc.sticky["observation"],
               "reward": sc.sticky["reward"],
               "done": sc.sticky["done"],
               "info": sc.sticky["info"]}
    agent_conn.send_object(msg_out)
    # Receive message
    msg_in = agent_conn.receive_object()
    if msg_in == "reset":
        reset = True
    elif msg_in == "close":
        reset = True
        agent_socket.close()
        sc.sticky["enabled"] = False
    else:
        action = msg_in
# ---------- end agent ----------
python_2 = GhPythonScript(action=agent.action, reset=agent.reset, render=Toggle(True))  # -> out, simplify(grid_world), simplify(color_state), simplify(obs_grid), house_cells, observation, reward, done, info; inputs action: Int32, reset: Boolean, render: Boolean
# ---------- python_2: Python ----------
"""Implementation of an RL environment class based on 
the 'Beady Ring' model (Hillier & Hanson, 1984).
    Inputs:
        x: The x script variable
        y: The y script variable
    Output:
        a: The a output variable"""

import random
from math import floor
import scriptcontext as sc
import ghpythonlib.components as ghcomp
import ghpythonlib.treehelpers as th


class BeadyRing_env:
    def __init__(self):
        self._carrier_color = 127.5
        self._house_color = 0
        self._street_color = 255
        self._cell_size = 3
        self._max_row_len = 21
        self._obs_size = 9
        self._3d = False
        self.pad = int(floor(self._obs_size/2))
        self.max_world_row_len = int(self._max_row_len + 2*self.pad)
        self.iter = 0
        
        # grid world
        xy_plane = ghcomp.XYPlane(ghcomp.ConstructPoint(0, 0, 0))
        cell, _ = ghcomp.Rectangle(xy_plane, self._cell_size, self._cell_size, 0)
        
        r_max = self._cell_size * self.max_world_row_len
        move_range = [i for i in range(0, r_max, self._cell_size)]
        
        y_vec = ghcomp.UnitY(move_range)
        cell_col, _ = ghcomp.Move(cell, y_vec)
        
        x_vec = ghcomp.UnitX(move_range)
        grid_world = []
        for c in cell_col:
            cell_row, _ = ghcomp.Move(c, x_vec)
            grid_world.append(cell_row)
        
        self.grid_world = ghcomp.ReverseList(grid_world)
        
        # initial location
        self.R = int(floor(self.max_world_row_len/2))
        self.C = int(floor(self.max_world_row_len/2))
        
        R_space = [r for r in range(int(self.pad), int(self._max_row_len + self.pad))]
        C_space = [c for c in range(int(self.pad), int(self._max_row_len + self.pad))]
        self.RC_space = [[[r, c] for c in C_space] for r in R_space]
        
        self.x = self.R - self.pad
        self.y = self.C - self.pad
        
        self.cell = [[self.x, self.y], [self.R, self.C]]
        self.adjacent_cells = [[[self.x, self.y], [self.R, self.C]]]
        self.adj_cells = [[[self.x, self.y], [self.R, self.C]]]
        
        # initial state
        self.state = [[self._carrier_color for _ in range(int(self.max_world_row_len))] 
                        for _ in range(int(self.max_world_row_len))]
        
        # initial observation
        self.observation = self.get_obs()

    def step(self, _cell_state):
        self.iter += 1
        # update state step
        self.state[self.R][self.C] = 255*_cell_state
        
        for i, a in enumerate(self.adj_cells):
            if a == self.cell:
                del self.adj_cells[i]
        
        adjacent = self.get_adjacent()
        
        # reward
        reward = 0
        adj_street_count = 0
        
        for a in adjacent:
            if int(self.state[a[1][0]][a[1][1]]) == 255:
                adj_street_count += 1
        
        if _cell_state == 1:
            if adj_street_count >= 3:
                reward -= 1
            elif adj_street_count == 0:
                reward -= 1
            elif 0 < adj_street_count < 3:
                reward += 1
        elif _cell_state == 0:
            # density metric
            reward += 1/self._max_row_len
            if adj_street_count == 0:
                reward -= 1
            elif adj_street_count >= 3:
                reward -= 1
            elif 0 < adj_street_count < 3:
                reward += 2
        
        for item in adjacent:
            if item not in self.adjacent_cells:
                self.adjacent_cells.append(item)
                self.adj_cells.append(item)
        
        # done
        done = False
        if len(self.adj_cells) == 0:
            done = True
        elif len(self.adj_cells) > 0:
            # next action location selection
            self.cell = random.choice(self.adj_cells)
            
            self.x = self.cell[0][0]
            self.y = self.cell[0][1]
            
            self.R = self.cell[1][0]
            self.C = self.cell[1][1]
        
        # observation
        self.observation = self.get_obs()
        
        return self.observation, reward, done, {}

    def reset(self):
        # initial state
        self.state = [[self._carrier_color for _ in range(int(self.max_world_row_len))] 
                        for _ in range(int(self.max_world_row_len))]
        
        # reset step counter
        self.iter = 0
        
        # initial location
        self.R = int(floor(self.max_world_row_len/2))
        self.C = int(floor(self.max_world_row_len/2))
        
        self.x = self.R - self.pad
        self.y = self.C - self.pad
        
        self.cell = [[self.x, self.y], [self.R, self.C]]
        self.adjacent_cells = [[[self.x, self.y], [self.R, self.C]]]
        self.adj_cells = [[[self.x, self.y], [self.R, self.C]]]
        
        # initial observation
        self.observation = self.get_obs()
        
        return self.observation

    def render(self):
        # state visualization
        color_state = [ghcomp.ColourRGB(255, self.state[i], self.state[i], 
                        self.state[i]) for i in range(self.max_world_row_len)]
        
        # observation grid
        left_up_R = int(self.R - self.pad)
        left_up_C = int(self.C - self.pad)
        right_bottom_R = int(self.R + self.pad)
        right_bottom_C = int(self.C + self.pad)
        obs_grid_ = []
        for i in range(left_up_R, right_bottom_R + 1):
            obs_grid_.append(self.grid_world[i][left_up_C : right_bottom_C + 1])
        
        return color_state, obs_grid_

    def get_obs(self):
        # observation
        left_up_R = int(self.R - self.pad)
        left_up_C = int(self.C - self.pad)
        right_bottom_R = int(self.R + self.pad)
        right_bottom_C = int(self.C + self.pad)
        obs_ = []
        for i in range(left_up_R, right_bottom_R + 1):
            obs_row = []
            for j in range(left_up_C, right_bottom_C + 1):
                item = self.state[i][j]
                obs_row.append(item)
            obs_.append(obs_row)
        return obs_

    def get_adjacent(self):
        # von Neumann neighbourhood
        adjacent = []
        if self.x < len(self.RC_space) - 1:
            adjacent.append([[self.x+1, self.y], self.RC_space[self.x+1][self.y]])
        if self.y > 0:
            adjacent.append([[self.x, self.y-1], self.RC_space[self.x][self.y-1]])
        if self.x > 0:
            adjacent.append([[self.x-1, self.y], self.RC_space[self.x-1][self.y]])
        if self.y < len(self.RC_space[self.x]) - 1:
            adjacent.append([[self.x, self.y+1], self.RC_space[self.x][self.y+1]])
        return adjacent

    def get_house_cells(self):
        ## house cells
        house_cells_ = []
        for i in range(self.max_world_row_len):
            for j in range(self.max_world_row_len):
                if self.state[i][j] == 0:
                    house_cells_.append(self.grid_world[i][j])
        return house_cells_

if 'env' not in globals():
    env = BeadyRing_env()
    sc.sticky['env'] = env

if reset:
    observation = sc.sticky['env'].reset()
    reward = None
    done = False
    info = {
    "action_space": "gym.spaces.Discrete(2)",
    "observation_space": "gym.spaces.Box(low=0, high=255, shape=(1, {n}, {n}), dtype=np.uint8)".format(n=sc.sticky['env']._obs_size)
    }
    
elif action is not None:
    observation, reward, done, info = sc.sticky['env'].step(action)
    
else:
    raise RuntimeError("Either reset or action must be provided")

if render:
    grid_world_ = th.list_to_tree(sc.sticky['env'].grid_world, source=[0,0])
    color_state, obs_grid = sc.sticky['env'].render()
    color_state_ = th.list_to_tree(color_state, source=[0,0])
    obs_grid_ = th.list_to_tree(obs_grid, source=[0,0])
    if sc.sticky['env']._3d:
        house_cells = sc.sticky['env'].get_house_cells()
        house_cells_ = th.list_to_tree(house_cells, source=[0,0])

sc.sticky["observation"] = observation
sc.sticky["reward"] = reward
sc.sticky["done"] = done
sc.sticky["info"] = info
# ---------- end python_2 ----------
cluster = Cluster(srf=python_2.grid_world, M=python_2.color_state, srf_2=python_2.obs_grid, srf_3=python_2.house_cells)
hs_2 = HoopSnake(
    StartingData=number_slider_3,
    Data=python_3.f,
    Hoopsnake_Data_autoUpdate=False,
    Hoopsnake_Data_dataLimit=2147483647,
    Hoopsnake_Data_resetCounter=True,
    Hoopsnake_Data_updateView=True)  # -> Feedback, CumulativeFeedback, LoopsCounter, IterationsCounter; disabled
python_3 = GhPythonScript(f=hs_2.Feedback, iter=hs_2.IterationsCounter)  # -> out, a, iter, f; inputs f: Int32, iter: Int32; disabled
# ---------- python_3: Python ----------
__author__ = "heh"
__version__ = "2022.03.10"

import random

iter_ = _iter
a = random.choice([f, 1])
# ---------- end python_3 ----------
panel = Panel(python_3.iter)  # disabled
python_4 = GhPythonScript(max_row_len=max_row_len, obs_size=obs_size, cell_state=python_3.a)  # -> simplify(color_state), simplify(obs), simplify(obs_grid), house_cells; inputs max_row_len: Int32, obs_size: Int32; disabled
# ---------- python_4: Python ----------
from math import *
import random
import scriptcontext as sc
import ghpythonlib.components as ghcomp
import ghpythonlib.treehelpers as th
        
        
pad = int(floor(_obs_size/2))
max_world_row_len = int(_max_row_len + 2*pad)
        
# action location selection
innit_R = int(floor(max_world_row_len/2))
innit_C = int(floor(max_world_row_len/2))
        
def get_adjacent(x, y):
    adjacent = []
    if x < len(sc.sticky['RC_space']) - 1:
        adjacent.append([[x+1, y], sc.sticky['RC_space'][x+1][y]])
    if y > 0:
        adjacent.append([[x, y-1], sc.sticky['RC_space'][x][y-1]])
    if x > 0:
        adjacent.append([[x-1, y], sc.sticky['RC_space'][x-1][y]])
    if y < len(sc.sticky['RC_space'][sc.sticky['x']]) - 1:
        adjacent.append([[x, y+1], sc.sticky['RC_space'][x][y+1]])
    return adjacent

RC = sc.sticky['RC_space'][sc.sticky['x']][sc.sticky['y']]
R, C = RC[0], RC[1]

# update state
sc.sticky['state'][R][C] = 255*_cell_state

for i, a in enumerate(sc.sticky['adj_cells']):
    if a[1] == [R, C]:
        del sc.sticky['adj_cells'][i]

adjacent = get_adjacent(sc.sticky['x'], sc.sticky['y'])

for item in adjacent:
    exist = False
    for c in sc.sticky['adjacent_cells']:
        if item[1] == c[1]:
            exist = True
            break
    if not exist:
        sc.sticky['adjacent_cells'].append(item)
        sc.sticky['adj_cells'].append(item)

cell = random.choice(sc.sticky['adj_cells'])
sc.sticky['x'] = cell[0][0]
sc.sticky['y'] = cell[0][1]

# state visualization
color_state = [ghcomp.ColourRGB(255, sc.sticky['state'][i], sc.sticky['state'][i], 
                sc.sticky['state'][i]) for i in range(max_world_row_len)]
color_state_ = th.list_to_tree(color_state, source=[0,0])
        
# observation
left_up_R = int(R - pad)
left_up_C = int(C - pad)
right_bottom_R = int(R + pad)
right_bottom_C = int(C + pad)
        
obs_ = []
for i in range(left_up_R, right_bottom_R + 1):
    obs_row = []
    for j in range(left_up_C, right_bottom_C + 1):
        item = sc.sticky['state'][i][j]/255
        obs_row.append(item)
    obs_.append(obs_row)
obs_ = th.list_to_tree(obs_, source=[0,0])
        
# observation grid
obs_grid_ = []
for i in range(left_up_R, right_bottom_R + 1):
    obs_grid_.append(sc.sticky['grid_world'][i][left_up_C : right_bottom_C + 1])
obs_grid_ = th.list_to_tree(obs_grid_, source=[0,0])
        
# house cells
house_cells_ = []
for i in range(max_world_row_len):
    for j in range(max_world_row_len):
        if sc.sticky['state'][i][j]/255 == 0:
            house_cells_.append(sc.sticky['grid_world'][i][j])
house_cells_ = th.list_to_tree(house_cells_, source=[0,0])
# ---------- end python_4 ----------
srf_2 = Surface(python_4.obs_grid)  # disabled
srf_3 = Surface(python_4.house_cells)  # disabled
lng = ListLength(List=srf_3)  # disabled
preview = CustomPreview(Geometry=srf, Material=python_4.color_state)  # disabled
preview_2 = CustomPreview(Geometry=srf_2, Material=swatch)  # disabled
panel_2 = Panel(python_4.obs)  # disabled
random = Random(Range=Domain(4, 8), Number=lng, Seed=number_slider_4, Integers=True)  # disabled
Z = UnitZ(Factor=random)  # disabled
extr = Extrude(Base=srf_3, Direction=Z)  # disabled
preview_3 = CustomPreview(Geometry=extr, Material=swatch_2)  # disabled

# ==== cluster Cluster
srf = ClusterInput()
M = ClusterInput()
srf_2 = ClusterInput()
srf_3 = ClusterInput()
srf_4 = Surface(srf)
srf_5 = Surface(srf_3)
preview = CustomPreview(Geometry=srf_4, Material=M)
lng = ListLength(List=srf_5)
srf_6 = Surface(srf_2)
random = Random(Range=Domain(4, 8), Number=lng, Seed=Slider(76, range=0..100), Integers=True)
preview_2 = CustomPreview(Geometry=srf_6, Material=ColourSwatch(SwatchColor=RGBA(0, 133, 105, 100)))
Z = UnitZ(Factor=random)
extr = Extrude(Base=srf_5, Direction=Z)
preview_3 = CustomPreview(Geometry=extr, Material=ColourSwatch(SwatchColor=RGB(0, 0, 0)))
